# Dynamo graph CBPointPointLine.dyn (Dynamo 2.5.0.6241)

code_block = CodeBlock { 7; }
byCoordinates = Point.ByCoordinates(y=code_block)
byCoordinates_2 = Point.ByCoordinates(z=code_block)
byStartPointEndPoint = Line.ByStartPointEndPoint(startPoint=byCoordinates, endPoint=byCoordinates_2)
